# Grasshopper definition work01(1).gh (Grasshopper 1.0.7)

i = Slider(2, range=0..5)
multiplication = Multiplication(A="15", HR=Slider(0.6, range=0.6..1.6))
eval = Evaluate(F="0.2*R+i*(H-0.2*R)/5", R="15", H=multiplication, i=i)
eval_2 = Evaluate(F="0.2*R+i*0.8*R/5", R="15", i=i)
pt = ConstructPoint(XCoordinate="0", YCoordinate="15", ZCoordinate="0")
pt_2 = ConstructPoint(XCoordinate="0", YCoordinate="15", ZCoordinate=eval)
pt_3 = ConstructPoint(XCoordinate="0", YCoordinate=eval_2, ZCoordinate=multiplication)
pt_4 = ConstructPoint(XCoordinate="0", YCoordinate="0", ZCoordinate=multiplication)
ln = Line(StartPoint=pt, EndPoint=pt_2)
ln_2 = Line(StartPoint=pt_4, EndPoint=pt_3)
bzspan = BezierSpan(StartPoint=pt, StartTangent=ln, EndPoint=pt_4, EndTangent=ln_2)  # -> Curve, Length, Domain
xz = XZPlane(Origin=Point(0, 0, 0))
mirror = Mirror(Geometry=bzspan.Curve, Plane=xz)  # -> Geometry, Transform
flip = FlipCurve(Curve=mirror.Geometry)  # -> Curve, Flag
X = UnitX(Factor=Slider(60, range=0..100))
join = JoinCurves(Curves=[flip.Curve, bzspan.Curve], Preserve=False)
move = Move(Geometry=join, Motion=X)  # -> Geometry, Transform
rulesrf = RuledSurface(CurveA=join, CurveB=move.Geometry)
